# Grasshopper definition JSON Example.ghx (Grasshopper 0.9.70)
# plug-ins: ghJSON

child = GetChild(Parent="$", ObjectName="store")
child_2 = GetChild(Parent=child, ObjectName="book")
panel = Panel("""{ "store": {
  "book": [ 
  { "category": "reference",
  "author": "Nigel Rees",
  "title": ["Sayings of the Century", "test"],
  "price": 8.95
  },
  { "category": "fiction",
  "author": "Evelyn Waugh",
  "title": ["Sword of Honour"],
  "price": 12.99
  },
  { "category": "fiction",
  "author": "Herman Melville",
  "title": ["Moby Dick"],
  "isbn": "0-553-21311-3",
  "price": 8.99
  },
  { "category": "fiction",
  "author": "J. R. R. Tolkien",
  "title": ["The Lord of the Rings"],
  "isbn": "0-395-19395-8",
  "price": 22.99
}
],
"bicycle": {
  "color": "red",
  "price": 19.95
}
}
}""")
child_3 = GetChild(Parent="$", ObjectName="store")
series = Series(Start=0, Step=1, Count=4)
allchldrn = GetAllChildren(Parent=child_3)
int = Integer(series)
element = GetElement(C=child_2, I=int)
child_4 = GetChild(Parent=element, ObjectName="title")
fromjson = FromJSON(JSON=panel)
element_2 = GetElement(C=allchldrn, I="0")
concat = Concatenate(FragmentA="$.store.book[", FragmentB=int, FragmentC="].title[*]")
allchldrn_2 = GetAllChildren(Parent=child_4)
all = AllElements(Collection=child_4)
panel_2 = Panel(fromjson)
# $.store.book.*.title.*
jpath = JPath(JObject=fromjson, JPathQuery=allchldrn_2)
panel_3 = Panel(jpath)
